vi "index.gviweb"   [LabVIEW NXG 4.0.0]
panel indicators:
  "value": bool
  "Chart": i32
diagram:
  # Place setup code before the loop. For example, perform initial data communication and wire the results into the loop.
  # Top-Level WebVIs usually contain a While Loop that never stops so that they can continue running as long as the web page is open in the user's web browser.
  s1 = uninitialised  # shift register
  while (iteration -> i1) {
    Not(x=FALSE) -> w1
    Quotient And Remainder(x=i1, y=20) -> (x-y*floor(x/y)=w2)
    Is Equal To 0(x=w2) -> w3
    Select(s=w3, t=FALSE, f=w1) -> w4
    $value <- w4
    Wait(time to wait=50)
    $Chart <- w2
    next s1 = w4
    stop if FALSE
  }
